# Dynamo graph SpaceLatentLoads.dyn (Dynamo 2.4.0.6186)

element_types = ElementTypes("EnergyAnalysisSpace")  # graph output
all_elements_of_type = ElementsOfType(element_type=element_types)
code_block = CodeBlock { "Peak Latent Load"; }
code_block_2 = CodeBlock { "C:/Users/npflaum/AppData/Local/Temp/f6d37014-65d0-4a66-946d-73f7f762d072/HVAC Systems Loads and Sizing/run/space_latent_load.json"; }
file_from_path = FileObject(path=code_block_2)
readText = FileSystem.ReadText(file=file_from_path)
parseJSON = Data.ParseJSON(json=readText)
id = Element.Id(element=all_elements_of_type)
string_from_object = FromObject(obj=id)
valueAtKey = DesignScript.Builtin.Dictionary.ValueAtKey(dictionary=parseJSON, key=string_from_object)
setParameterByName = Element.SetParameterByName(element=all_elements_of_type, parameterName=code_block, value=valueAtKey)
